# Dynamo graph shared_parameter_to_project_parameter.dyn (Dynamo 2.18.1.5096)
# author: OpenAI Codex
# Read shared parameter groups, select groups, and bind selected definitions to selected Revit categories.

# group: 1. Check Group List
# Run once, read the indexed group names in Group List Watch, then type the wanted index values into Group Indexes.
file_path = Filename("P:\@이혜정\@충북선 고속화\철도WBS표준분류체계_공유 매개변수.txt")
group_list_python = Python(IN[0]=file_path)  # CPython3
# ---------- group_list_python.python (6 lines) ----------
script_path = r"C:\Users\user\Desktop\codex\#shared_parameter_to_project_parameter\\shared_parameter_group_list.py"
namespace = {"IN": IN}
with open(script_path, "r", encoding="utf-8") as handle:
    code = handle.read()
exec(compile(code, script_path, "exec"), namespace)
OUT = namespace.get("OUT")
# ----------------------------------------
group_indexes = StringInput("0")
boolean = BoolSelector(false)
group_select_python = Python(IN[0]=group_list_python, IN[1]=group_indexes, IN[2]=boolean)  # CPython3
# ---------- group_select_python.python (6 lines) ----------
script_path = r"C:\Users\user\Desktop\codex\#shared_parameter_to_project_parameter\\shared_parameter_group_select.py"
namespace = {"IN": IN}
with open(script_path, "r", encoding="utf-8") as handle:
    code = handle.read()
exec(compile(code, script_path, "exec"), namespace)
OUT = namespace.get("OUT")
# ----------------------------------------
group_list_watch = Watch(group_list_python)

# group: 2. Import To Project
# After confirming the group numbers above, set Group Indexes and run this section to bind the selected shared parameters.
parameter_group = StringInput("PG_DATA")
instance_truefalse = CodeBlock { true; }
category = Categories("OST_LightingFixtures")
category_2 = Categories("OST_ElectricalFixtures")
category_3 = Categories("OST_CableTrayFitting")
category_4 = Categories("OST_CableTray")
category_5 = Categories("OST_ElectricalEquipment")
category_list = List.Create(item0=category, item1=category_2, item2=category_3, item3=category_4, item4=category_5)
main_import_python = Python(IN[0]=file_path, IN[1]=parameter_group, IN[2]=instance_truefalse, IN[3]=category_list, IN[4]=group_select_python)  # CPython3
# ---------- main_import_python.python (6 lines) ----------
script_path = r"C:\Users\user\Desktop\codex\#shared_parameter_to_project_parameter\\shared_parameter_to_project_parameter.py"
namespace = {"IN": IN}
with open(script_path, "r", encoding="utf-8") as handle:
    code = handle.read()
exec(compile(code, script_path, "exec"), namespace)
OUT = namespace.get("OUT")
# ----------------------------------------
